# Dynamo graph TestScript.dyn (Dynamo 1.3.0.875)

byCoordinates_Restrained = JointSolver2D.Dynamo.JSNode.ByCoordinates_Restrained()  # unwired: arg0, arg1
code_block = CodeBlock {  }
x1 = DoubleSlider(0, range=0..100 step 0.1)
number_slider = DoubleSlider(1, range=0..100 step 0.1)
byCoordinates = Point.ByCoordinates(x=x1, y=number_slider)
byCoordinates_Released = JointSolver2D.Dynamo.JSNode.ByCoordinates_Released(x1, number_slider)
x2 = DoubleSlider(4.6, range=0..100 step 0.1)
code_block_2 = CodeBlock(x1=x1, x2=x2)
# ---------- code_block_2.designscript (6 lines) ----------
sup1_x = x1;
sup1_y = 0;
sup2_x = x2;
sup2_y = 0;
sup1_pt = Autodesk.Point.ByCoordinates(sup1_x, sup1_y, 0);
sup2_pt = Autodesk.Point.ByCoordinates(sup2_x, sup2_y, 0);
# ----------------------------------------
byCoordinates_Restrained_2 = JointSolver2D.Dynamo.JSNode.ByCoordinates_Restrained(code_block_2.sup1_x, code_block_2.sup1_y)
byCoordinates_Restrained_3 = JointSolver2D.Dynamo.JSNode.ByCoordinates_Restrained(code_block_2.sup2_x, code_block_2.sup2_y)
nodes = List.Create(byCoordinates_Released, byCoordinates_Restrained_2, byCoordinates_Restrained_3)
byStartNodeEndNode = JointSolver2D.Dynamo.JSBar.ByStartNodeEndNode(byCoordinates_Released, byCoordinates_Restrained_2)
byStartNodeEndNode_2 = JointSolver2D.Dynamo.JSBar.ByStartNodeEndNode(byCoordinates_Released, byCoordinates_Restrained_3)
bars = List.Create(byStartNodeEndNode, byStartNodeEndNode_2)
number_slider_2 = DoubleSlider(10.8, range=0..100 step 0.1)
number_slider_3 = DoubleSlider(20.3, range=0..100 step 0.1)
pointLoad = JointSolver2D.Dynamo.JSLoads.PointLoad(number_slider_2, number_slider_3, byCoordinates_Released)
loads = List.Create(pointLoad)
execute = JointSolver2D.Dynamo.Analysis.Execute(nodes, bars, loads)
getAllBarForces = JointSolver2D.Dynamo.Analysis.GetAllBarForces(execute)
watch = Watch(getAllBarForces)
getAllNodeReactions = JointSolver2D.Dynamo.Analysis.GetAllNodeReactions(execute)
watch_2 = Watch(getAllNodeReactions.out0)
watch_3 = Watch(getAllNodeReactions.out1)
writeDebugReport = JointSolver2D.Dynamo.Analysis.WriteDebugReport(execute)
watch_4 = Watch(writeDebugReport)
